# Grasshopper definition vultureDefinition.gh (Grasshopper 0.9.72)
# plug-ins: VultureGH

number_slider = Slider(10, range=0..10)
ellipse = Ellipse(Plane=PlaneXY(0, 0, 0), Radius1=Slider(10, range=0..10), Radius2=Slider(5.89, range=0..10))  # -> Ellipse, Focus1, Focus2
series = Series(Start=0, Step=Slider(5, range=0..10), Count=number_slider)
Z = UnitZ(Factor=series)
mbox = MeshBox(Base={Plane=PlaneXY(0, 0, 0), X=Domain(-10, 10), Y=Domain(-10, 10), Z=Domain(-10, 10)}, XCount=10, YCount=10, ZCount=10)
series_2 = Series(Start=0, Step=Slider(0, range=0..1), Count=number_slider)
move = Move(Geometry=ellipse.Ellipse, Motion=Z)  # -> Geometry, Transform
rotate = Rotate(Geometry=mbox, Angle=Slider(2.53, range=0..10), Plane=PlaneXY(0, 0, 0))  # -> Geometry, Transform
rotate_2 = Rotate(Geometry=move.Geometry, Angle=series_2, Plane=PlaneXY(0, 0, 0))  # -> Geometry, Transform
tri = Triangulate(Mesh=rotate.Geometry)  # -> Mesh, Count
loft = Loft(
    Curves=rotate_2.Geometry,
    Options={Adjust=False, Closed=False, LoftEnds=0, LoftSimp=0, LoftType=0, Rebuild=10, Refit=0.01})
cap = CapHoles(Brep=loft)
tri_2 = Triangulate(Mesh=cap)  # -> Mesh, Count
demesh = DeconstructMesh(Mesh=tri_2.Mesh)  # -> Vertices, Faces, Colours, Normals
lng = ListLength(List=demesh.Vertices)
lng_2 = ListLength(List=demesh.Faces)
vulture = VultureGH(Mesh=cap, WriteFile=True, Path="C:\TEMP\")
multiplication = Multiplication(A=lng, B=3)
multiplication_2 = Multiplication(A=lng_2, B=3)
panel = Panel(multiplication)
panel_2 = Panel(multiplication_2)
